% Simulink data dictionary soc.sldd

NeSoc_bi_NvmImprtScsf = Simulink.Signal(StorageClass="ExportedGlobal", DataType="boolean", Min=0, Max=1)
VeSoc_ms_BattAsleepTime = Simulink.Signal(StorageClass="ExportedGlobal", DataType="uint32")
NeSoc_ms_InitBattRestTime = Simulink.Signal(StorageClass="ExportedGlobal", DataType="uint32")
VeSoc_ms_BattRestTime = Simulink.Signal(StorageClass="ExportedGlobal", DataType="uint32")
VeSoc_A_Battcur = Simulink.Signal(StorageClass="ExportedGlobal", DataType="single")
VeSoc_pct_PackSoc = Simulink.Signal(StorageClass="ExportedGlobal", DataType="single")
VeSoc_pct_UserSoc = Simulink.Signal(StorageClass="ExportedGlobal", DataType="single")
VeSoc_pct_minSoc = Simulink.Signal(StorageClass="ExportedGlobal", DataType="single")
VeSoc_pct_maxSoc = Simulink.Signal(StorageClass="ExportedGlobal", DataType="single")
VeSoc_pct_SocReset = Simulink.Signal(StorageClass="ExportedGlobal", DataType="single")
VeSoc_degC_MinCellTmp = Simulink.Signal(StorageClass="ExportedGlobal", DataType="single")
VeSoc_degC_MaxCellTmp = Simulink.Signal(StorageClass="ExportedGlobal", DataType="single")
VaSoc_V_CellVolt = Simulink.Signal(StorageClass="ExportedGlobal", DataType="single", Dimensions="SOC_NUM_OF_CELLS")
NaSoc_pct_InitSoc = Simulink.Signal(StorageClass="ExportedGlobal", DataType="single", Dimensions="SOC_NUM_OF_CELLS")
VaSoc_degC_CellTmp = Simulink.Signal(StorageClass="ExportedGlobal", DataType="single", Dimensions="SOC_NUM_OF_CELLS")
VaSoc_pct_CellSohc = Simulink.Signal(StorageClass="ExportedGlobal", DataType="single", Dimensions="SOC_NUM_OF_CELLS")
VaSoc_pct_CellSoc = Simulink.Signal(StorageClass="ExportedGlobal", DataType="single", Dimensions="SOC_NUM_OF_CELLS")
VaSoc_pct_CellSocCc = Simulink.Signal(StorageClass="ExportedGlobal", DataType="single", Dimensions="SOC_NUM_OF_CELLS")
VaSoc_pct_CellSocOcv = Simulink.Signal(StorageClass="ExportedGlobal", DataType="single", Dimensions="SOC_NUM_OF_CELLS")
VaSoc_ms_TauDplr = Simulink.Signal(StorageClass="ExportedGlobal", DataType="single", Dimensions="SOC_NUM_OF_CELLS")
AH_TO_COULOMB = Simulink.Parameter(3600, StorageClass="ImportFromFile", HeaderFile="soc.h", DataType="single")  % Conversion factor to convert coulombs to ampere-hour.
SEC_TO_MILLISEC = Simulink.Parameter(1000, StorageClass="ImportFromFile", HeaderFile="soc.h", DataType="single")  % Conversion factor to convert seconds to milliseconds.
FRACTION_TO_PERCENT = Simulink.Parameter(100, StorageClass="ImportFromFile", HeaderFile="soc.h", DataType="single")
PERCENT_TO_FRACTION = Simulink.Parameter(0.01, StorageClass="ImportFromFile", HeaderFile="soc.h", DataType="single")
SOC_CELLS_IN_PARALLEL = Simulink.Parameter(48, StorageClass="ImportFromFile", HeaderFile="soc.h", DataType="int32")
VeSoc_bi_LowSocFault = Simulink.Signal(StorageClass="ExportedGlobal", DataType="boolean")
KeSoc_frc_LowSocSetThd = Simulink.Parameter(0.1, StorageClass="FileScope", DataType="single")
KeSoc_frc_LowSocResetThd = Simulink.Parameter(0.12, StorageClass="FileScope", DataType="single")
KeSoc_nu_SocCorrnFac = Simulink.Parameter(0.5, StorageClass="FileScope", DataType="single")  % SOC Correction factor
KeSoc_frc_TopOfChrgRst = Simulink.Parameter(1, StorageClass="FileScope", DataType="single")  % Value TBD
KeSoc_frc_BotmOfDchRst = Simulink.Parameter(0, StorageClass="FileScope", DataType="single")  % Value TBD
KeSoc_nu_RestTauFactor = Simulink.Parameter(3, StorageClass="FileScope", DataType="single")
KeSoc_frc_UserSocMaxLim = Simulink.Parameter(0.99, StorageClass="FileScope", DataType="single")
KeSoc_frc_UserSocMinLim = Simulink.Parameter(0.014, StorageClass="FileScope", DataType="single")
KeSoc_nu_EpsVal = Simulink.Parameter(2.220446e-16, StorageClass="FileScope")
KeSoc_A_RestingCurrent = Simulink.Parameter(4, StorageClass="FileScope", DataType="single")
KeSoc_V_BodMinCellVolt = Simulink.Parameter(2.993, StorageClass="FileScope", DataType="single")  % Value TBD
KeSoc_V_TocMaxCellVolt = Simulink.Parameter(4.5, StorageClass="FileScope", DataType="single")  % Value TBD
KeSoc_V_TocAvrgCellVolt = Simulink.Parameter(4.5, StorageClass="FileScope", DataType="single")  % Value TBD
KeSoc_frc_SocMaxLim = Simulink.Parameter(1, StorageClass="FileScope", DataType="single")  % SOC_MAX_LIMIT
KeSoc_frc_SocMinLim = Simulink.Parameter(0, StorageClass="FileScope", DataType="single")  % SOC_MIN_LIMIT
KeSoc_Ah_capacity = Simulink.Parameter(4.93, StorageClass="FileScope", DataType="single")
KaSoc_degC_tempLut = Simulink.Parameter([-35 -30 -20 -10 0 10 20 25 30 40 50 55 60], Dimensions="[1,SOC_LUT_TEMP_ARRAY_SIZE]", StorageClass="FileScope", DataType="single")

KaSoc_sec_tauDepolarLut = Simulink.Parameter([991.2 991.2 991.2 991.2 991.2 991.2 991.2 991.2 1151.2 1151.2 1151.2 1131.2 1111.2
 119 119 119 119 119 119 119 119 132.2 225.5 225.5 498.4 771.2
 111.8 111.8 111.8 111.8 111.8 111.8 111.8 111.8 103.2 89.3 89.3 84.3 79.2
 143 143 143 143 143 143 143 143 132.7 102.7 102.7 92.9 83
 147 147 147 147 147 147 147 147 117.5 89.3 89.3 80.9 72.5
 202.8 202.8 202.8 202.8 202.8 202.8 202.8 202.8 172.8 103.5 103.5 92.9 82.3
 168.7 168.7 168.7 168.7 168.7 168.7 168.7 168.7 165.7 151 151 154.5 158
 122.7 122.7 122.7 122.7 122.7 122.7 122.7 122.7 117.2 110.2 110.2 103 95.7
 112.8 112.8 112.8 112.8 112.8 112.8 112.8 112.8 105.8 90.2 90.2 82.4 74.5
 121.2 121.2 121.2 121.2 121.2 121.2 121.2 121.2 104.2 80.8 80.8 73.1 65.3
 242.8 242.8 242.8 242.8 242.8 242.8 242.8 242.8 185.3 109.7 109.7 92.1 74.5
 752.8 752.8 752.8 752.8 752.8 752.8 752.8 752.8 637.3 453 453 371.6 290.2
 337.7 337.7 337.7 337.7 337.7 337.7 337.7 337.7 254 137.6 137.6 114.2 90.7
 175.2 175.2 175.2 175.2 175.2 175.2 175.2 175.2 123.3 87.8 87.8 81.3 74.8
 125.5 125.5 125.5 125.5 125.5 125.5 125.5 125.5 105.2 88.7 88.7 83.8 78.8
 117.8 117.8 117.8 117.8 117.8 117.8 117.8 117.8 108.3 95.5 95.5 92.4 89.2
 122.3 122.3 122.3 122.3 122.3 122.3 122.3 122.3 114.8 105.7 105.7 102.5 99.2
 129 129 129 129 129 129 129 129 122.5 113.5 113.5 109.9 106.2
 157.5 157.5 157.5 157.5 157.5 157.5 157.5 157.5 154.5 150.2 150.2 149.3 148.3
 165.3 165.3 165.3 165.3 165.3 165.3 165.3 165.3 184.7 161.8 161.8 161.8 161.8
 731.2 731.2 731.2 731.2 731.2 731.2 731.2 731.2 451.2 711.2 711.2 731.2 751.2], Dimensions="[SOC_LUT_SOC_ARRAY_SIZE,SOC_LUT_TEMP_ARRAY_SIZE]", StorageClass="FileScope", DataType="single")

KaSoc_V_ocvLut = Simulink.Parameter([2.993 2.993 2.993 2.993 2.993 2.993 2.993 2.993 2.993 2.993 2.993 2.993 2.993
 3.173 3.175 3.181 3.187 3.165 3.177 3.17 3.168 3.167 3.166 3.161 3.158 3.155
 3.413 3.412 3.41 3.408 3.405 3.405 3.402 3.401 3.401 3.4 3.398 3.397 3.396
 3.469 3.469 3.467 3.466 3.463 3.464 3.461 3.46 3.46 3.459 3.457 3.456 3.456
 3.526 3.525 3.524 3.524 3.522 3.522 3.519 3.518 3.518 3.518 3.517 3.516 3.515
 3.562 3.561 3.561 3.56 3.559 3.56 3.558 3.558 3.558 3.558 3.558 3.557 3.557
 3.597 3.597 3.597 3.597 3.597 3.598 3.597 3.597 3.598 3.598 3.599 3.599 3.599
 3.623 3.623 3.623 3.623 3.624 3.624 3.624 3.625 3.625 3.626 3.627 3.627 3.627
 3.648 3.649 3.649 3.65 3.65 3.651 3.652 3.652 3.653 3.654 3.655 3.655 3.655
 3.687 3.687 3.688 3.689 3.69 3.691 3.691 3.692 3.692 3.693 3.694 3.694 3.694
 3.726 3.726 3.727 3.729 3.729 3.73 3.731 3.731 3.732 3.732 3.733 3.733 3.733
 3.794 3.794 3.794 3.794 3.794 3.794 3.794 3.794 3.794 3.795 3.794 3.794 3.793
 3.861 3.861 3.86 3.859 3.859 3.858 3.857 3.857 3.857 3.857 3.855 3.855 3.854
 3.898 3.897 3.897 3.896 3.896 3.896 3.894 3.894 3.894 3.894 3.893 3.892 3.892
 3.935 3.934 3.934 3.933 3.934 3.933 3.932 3.932 3.932 3.932 3.93 3.93 3.929
 3.987 3.986 3.985 3.985 3.986 3.985 3.984 3.983 3.983 3.983 3.982 3.981 3.98
 4.039 4.038 4.037 4.037 4.038 4.037 4.035 4.035 4.035 4.035 4.033 4.032 4.031
 4.061 4.061 4.061 4.061 4.062 4.061 4.061 4.061 4.061 4.061 4.06 4.06 4.059
 4.084 4.084 4.084 4.085 4.086 4.086 4.086 4.087 4.087 4.087 4.087 4.087 4.087
 4.126 4.125 4.124 4.123 4.125 4.124 4.122 4.122 4.122 4.122 4.119 4.118 4.117
 4.152 4.152 4.152 4.152 4.152 4.152 4.152 4.152 4.152 4.152 4.152 4.152 4.152], Dimensions="[SOC_LUT_SOC_ARRAY_SIZE,SOC_LUT_TEMP_ARRAY_SIZE]", StorageClass="FileScope", DataType="single")

KaSoc_frc_socLut = Simulink.Parameter([0; 0.05; 0.1; 0.15; 0.2; 0.25; 0.3; 0.35; 0.4; 0.45; 0.5; 0.55; 0.6; 0.65; 0.7; 0.75; 0.8; 0.85; 0.9; 0.95; 1], Dimensions="[SOC_LUT_SOC_ARRAY_SIZE,1]", StorageClass="FileScope", DataType="single")
KeSoc_sec_SampleTime = Simulink.Parameter(0.01, StorageClass="FileScope", DataType="single")
VeBattsm_nu_BattState = Simulink.Signal(StorageClass="ExportedGlobal", DataType="Enum: Battsm_State_t")
VeSoc_nu_SocState = Simulink.Signal(StorageClass="ExportedGlobal", DataType="Enum: Soc_State_t")
KeSoc_sec_SocBodSetTime = Simulink.Parameter(0, StorageClass="FileScope", DataType="single")  % Value TBD
KeSoc_sec_SocTocSetTime = Simulink.Parameter(0, StorageClass="FileScope", DataType="single")  % Value TBD
SOC_NUM_OF_CELLS = Simulink.Parameter(8, StorageClass="ImportedDefine", HeaderFile="soc.h", DataType="int32")
SOC_LUT_SOC_ARRAY_SIZE = Simulink.Parameter(21, StorageClass="Define", HeaderFile="soc_model.h", DataType="int32")
SOC_LUT_TEMP_ARRAY_SIZE = Simulink.Parameter(13, StorageClass="Define", HeaderFile="soc_model.h", DataType="int32")

Battsm_State_t = enum(DataScope="Imported", HeaderFile="soc.h", DefaultValue="BATTSM_STATE_STANDBY_INIT", IsTunableInCode=true)  % BMS State Enum
  BATTSM_STATE_STANDBY_INIT = 0
  BATTSM_STATE_STANDBY_NOT_READY = 1
  BATTSM_STATE_STANDBY_READY = 2
  BATTSM_STATE_PREPARE_BUS_PRECHG = 3
  BATTSM_STATE_PREPARE_BUS_EXT_ISOLATION_CHK = 4
  BATTSM_STATE_DRIVE = 5
  BATTSM_STATE_CHARGE = 6
  BATTSM_STATE_SUPPORT = 7
  BATTSM_STATE_DSNG_BUS_WAIT_FOR_CHK = 8
  BATTSM_STATE_DSNG_BUS_CNTC_WLD_CHK = 9
  BATTSM_STATE_FASTCHARGE = 10

Soc_State_t = enum(DataScope="Imported", HeaderFile="soc.h", DefaultValue="SOC_STATE_INIT", IsTunableInCode=true)  % SOC State Enum
  SOC_STATE_INIT = 0  % Default State
  SOC_STATE_RESET = 1
  SOC_STATE_CORRECTION_ON_WAKE = 2
  SOC_STATE_NORMAL = 3